# Grasshopper definition HopsMasterSheet.gh (Grasshopper 1.0.7)
# plug-ins: LunchBox, Human, Hops

# Beskrivelse: OC Engineering Grasshopper Template.
# Grafisk standard ses herunder.
# Højre klik på farve og sæt den til standard, grupper herefter og sæt kommentarer på gruppen.
# 
# 
# BESKRIVELSE AF SCRIPT:
# Script der bruges i hops, oploades til GitHub så der er mulighed for at dele hops med flere brugere, da der bruges et link af http.... typen, hvormed den ikke er bruger bestemt i form af en specifik sti.
# 
# TEORI:
# bla bla.
# 
# INPUT:
# bla bla.
# 
# OUTPUT:
# bla bla.
gældende_udgivelsesdato_og_version = Panel("15.03.2023 - 01.00.00.00")
# Output
# Input
# data
# geometry
# preview
# OBS
# big group
revisions_historik = Panel("15.03.2023 - 01.00.00.00 - første udgivelse")
udviklet_af = Panel("Daniel Bo Olesen")
projekt = Panel("SagsNr - SagsNavn")
tilføjelser_ændringer_der_kan_implemente = Panel("- Indbyg udbøjning formel")  # "Tilføjelser ændringer der kan implementeres"
# SETUP: DEVELOP AND MAINTAIN HOPS FUNCTIONS
# ----------------------------------
# Hops functions are uploaded to github repository.
# 
# Repository is cloned to local computer, this is your working folder. Use Github desktop app to commit changes etc. If pointed to a sharepoint folder or similar, your collegues etc. automaticly gets new changes without worrying about .git.
# ____________________________________
# 
# 
# 
# 
# 
# USE THE HOPS FUNCTIONS, SHARED FUNCTIONS
# -------------------------------------
# Go the File - Preferences - Solver, point the hops functions to the network sharepoint folder with GH_HopsFunctions (your repository) in it.
# Then you can right click a new hops component and select a .gh script from the folder. This folder is maintained by devolopers, using git.
# 
# ALL hops in this file point to the public github url, which makes them shareable.
# 
# Symbols to be used when making userObject are name the same as the .gh file and placed in the same repository folder.
# 
# Versioning and revision is controlled in the function files using the side panel.
# ______________________________________
image_sampler = ImageSampler(Filter="Colour", Interpolate=True, Umax=842, Umin=1, Vmax=595, Vmin=1, Wrap=1)
public_github_url_to_hooped_up_function = Panel("https://github.com/Slackking1/GH_HopsFunctions/raw/main/STATIK_SimplySupportedBeamWithUniformLoad.gh")
text_length = TextLength(Text=public_github_url_to_hooped_up_function)
bjælke_længde_i_meter = Slider(6.692, range=0..15)
last_i_kn_m = Slider(46, range=0..150)
antal_beregnings_punkter = Slider(112, range=0..200)
skala_kurver = Slider(0.00233, range=0..0.01)
text_fragment = TextFragment(Text=public_github_url_to_hooped_up_function, Start=0, Count=expr("x-3", text_length))
concatenate = Concatenate(FragmentA=text_fragment, FragmentB=".png")
simpelt_understøttet_bjælke_med_jævnt_fo = Hops(
    Længde=11.52,
    Last=50,
    AntalOpdelinger=128,
    SkalerKurve=0.002,
    CacheResultsInMemory=True,
    CacheSolveResults=False,
    RemoteDefinitionLocation="C:\Users\DBO\OC Engineering ApS\Ressourcer - Software and coding\Grasshopper og Rhino\GH_HopsFunctions\STATIK_SimplySupportedBeamWithUniformLoad.gh",
    RemoteSolveVersion=(0, 1, 0),
    ShowInput_Enabled=False,
    ShowInput_Path=False,
    SynchronousSolve=True)  # -> Bjælke, Mmax, MX, Mkurve, Vkurve, ReaktionGrafik, LodretReaktion, Vmax; "Simpelt understøttet bjælke med jævnt fordelt last"
hops = Hops(
    Længde=bjælke_længde_i_meter,
    Last=last_i_kn_m,
    AntalOpdelinger=antal_beregnings_punkter,
    SkalerKurve=skala_kurver,
    CacheResultsInMemory=True,
    CacheSolveResults=True,
    RemoteDefinitionLocation="C:\Users\DBO\OC Engineering ApS\Ressourcer - Software and coding\Grasshopper og Rhino\GH_HopsFunctions\STATIK_SimplySupportedBeamWithUniformLoad.gh",
    RemoteSolveVersion=(0, 1, 0),
    ShowInput_Enabled=False,
    ShowInput_Path=False,
    SynchronousSolve=True)  # -> Bjælke, Mmax, MX, Mkurve, Vkurve, ReaktionGrafik, LodretReaktion, Vmax
panel = Panel(concatenate)
curve = Curve(hops.Vkurve)
curve_2 = Curve(hops.Mkurve)
curve_3 = Curve(hops.ReaktionGrafik)
curve_4 = Curve(hops.Bjælke)
panel_2 = Panel(hops.Vmax)
panel_3 = Panel(hops.LodretReaktion)
panel_4 = Panel(hops.Mmax)
panel_5 = Panel(hops.MX)
panel_6 = Panel("https://github.com/Slackking1/GH_HopsFunctions")
mappe_med_hops_definationer = Panel("C:\Users\DBO\OC Engineering ApS\Ressourcer - Software and coding\Grasshopper og Rhino\GH_HopsFunctions\")
copy_paste_to_hops_public_github_url_to = Panel("https://github.com/Slackking1/GH_HopsFunctions/raw/main/STATIK%20simpelt%20underst%C3%B8ttet%20bj%C3%A6lke%20med%20j%C3%A6vnt%20fordelt%20linjelast.gh")  # "COPY PASTE TO HOPS, public github URL to hooped up function"
directory_contents = DirectoryContents(FolderPath=mappe_med_hops_definationer, Filter="*.gh", IncludeSubfolders=False)  # -> FilePaths, FileNames
text_length_2 = TextLength(Text=copy_paste_to_hops_public_github_url_to)
item_selector = ItemSelector(
    directory_contents.FileNames,
    {"HopsMasterSheet", "SHAPE_HyperbolicTowerWithColumns", "STATIK_SimplySupportedBeamWithUniformLoad"}, selected="STATIK_SimplySupportedBeamWithUniformLoad")
text_fragment_2 = TextFragment(Text=copy_paste_to_hops_public_github_url_to, Start=0, Count=expr("x-3", text_length_2))
concatenate_2 = Concatenate(FragmentA=text_fragment_2, FragmentB=".png")
concatenate_3 = Concatenate(Fragment_A=mappe_med_hops_definationer, Fragment_B=item_selector, A=".gh")

# ---- group: Edit hops definition
launch_application = LaunchApplication(LaunchToggle=Button(), ApplicationPath=concatenate_3)

# ----
panel_7 = Panel(concatenate_2)
hops_2 = Hops(
    _Path=concatenate_3,
    Længde=11.52,
    Last=50,
    AntalOpdelinger=128,
    SkalerKurve=0.002,
    CacheResultsInMemory=True,
    CacheSolveResults=True,
    RemoteDefinitionLocation="C:\Users\DBO\OC Engineering ApS\Ressourcer - Software and coding\Grasshopper og Rhino\GH_HopsFunctions\STATIK_SimplySupportedBeamWithUniformLoad.gh",
    RemoteSolveVersion=(0, 1, 0),
    ShowInput_Enabled=False,
    ShowInput_Path=True,
    SynchronousSolve=True)  # -> Bjælke, Mmax, MX, Mkurve, Vkurve, ReaktionGrafik, LodretReaktion, Vmax
hops_shared_folder_path_after_username = Panel("\OC Engineering ApS\Ressourcer - Software and coding\Grasshopper og Rhino\GH_HopsFunctions\")
get_username_of_current_user = GhPythonScript()  # -> username; same code as get_username_of_current_user
hops_shared_folder_path_before_username = Panel("C:\Users\")
username = Panel(get_username_of_current_user)
concatenate_4 = Concatenate(Fragment_A=hops_shared_folder_path_before_username, Fragment_B=username, A=hops_shared_folder_path_after_username)
directory_contents_2 = DirectoryContents(FolderPath=concatenate_4, Filter="*.gh", IncludeSubfolders=False)  # -> FilePaths, FileNames
item_selector_2 = ItemSelector(
    directory_contents_2.FileNames,
    {"HopsMasterSheet", "SHAPE_HyperbolicTowerWithColumns", "STATIK_SimplySupportedBeamWithUniformLoad"}, selected="STATIK_SimplySupportedBeamWithUniformLoad")

# ---- group: OceHops / SHAPE
hyperbolictower = HyperbolicTowerWithColumn(
    height_m=11.52,
    radius_top_m=50,
    radius_bottom_m=128,
    foundations_amount=0.002,
    rotation_sections_amount=6,
    topbeam_radius_m=0.19149,
    columns_radius_m=0.19149)  # -> centerline_top_beam, centerlines_columns, top_beam, columns

# ---- group: OceHops / STATIK
simplebeamuniform = SimplySupportedBeamUniformLoad(længde=11.52, last=50, antal_opdelinger=128, skaler_kurve=0.002)  # -> bjælke, mmax, m_x, mkurve, vkurve, reaktion_grafik, lodret_reaktion, vmax

# ----
concatenate_5 = Concatenate(Fragment_A=concatenate_4, Fragment_B=item_selector_2, A=".gh")

# ---- group: Edit hops definition
launch_application_2 = LaunchApplication(LaunchToggle=Button(), ApplicationPath=concatenate_5)

# ----
hops_3 = Hops(
    _Path=concatenate_5,
    Længde=11.52,
    Last=50,
    AntalOpdelinger=128,
    SkalerKurve=0.002,
    CacheResultsInMemory=True,
    CacheSolveResults=True,
    RemoteDefinitionLocation="C:\Users\DBO\OC Engineering ApS\Ressourcer - Software and coding\Grasshopper og Rhino\GH_HopsFunctions\STATIK_SimplySupportedBeamWithUniformLoad.gh",
    RemoteSolveVersion=(0, 1, 0),
    ShowInput_Enabled=False,
    ShowInput_Path=True,
    SynchronousSolve=True)  # -> Bjælke, Mmax, MX, Mkurve, Vkurve, ReaktionGrafik, LodretReaktion, Vmax

# ==== cluster SimplySupportedBeamUniformLoad: Calculates a simply supported beam with uniform load. Generated graphic for forces
hops_shared_folder_path_after_username = Panel("\OC Engineering ApS\Ressourcer - Software and coding\Grasshopper og Rhino\GH_HopsFunctions\")
get_username_of_current_user = GhPythonScript()  # -> username
# ---------- get_username_of_current_user: Python ----------
import System.Environment as env 
username = env.UserName
# ---------- end get_username_of_current_user ----------
hops_shared_folder_path_before_username = Panel("C:\Users\")
username = Panel(get_username_of_current_user)
concatenate = Concatenate(Fragment_A=hops_shared_folder_path_before_username, Fragment_B=username, A=hops_shared_folder_path_after_username)
directory_contents = DirectoryContents(FolderPath=concatenate, Filter="*.gh", IncludeSubfolders=False)  # -> FilePaths, FileNames
item_selector = ItemSelector(
    directory_contents.FileNames,
    {"HopsMasterSheet", "SHAPE_HyperbolicTowerWithColumns", "STATIK_SimplySupportedBeamWithUniformLoad"}, selected="STATIK_SimplySupportedBeamWithUniformLoad")
enabled = ClusterInput()
længde = ClusterInput()
last = ClusterInput()
antal_opdelinger = ClusterInput()
skaler_kurve = ClusterInput()
concatenate_2 = Concatenate(Fragment_A=concatenate, Fragment_B=item_selector, A=".gh")

# ---- group: Edit hops definition
launch_application = LaunchApplication(LaunchToggle=Button(), ApplicationPath=concatenate_2)

# ----
hops = Hops(
    _Path=concatenate_2,
    _Enabled=[enabled, Toggle(False)],
    Længde=længde,
    Last=last,
    AntalOpdelinger=antal_opdelinger,
    SkalerKurve=skaler_kurve,
    CacheResultsInMemory=True,
    CacheSolveResults=True,
    RemoteDefinitionLocation="C:\Users\DBO\OC Engineering ApS\Ressourcer - Software and coding\Grasshopper og Rhino\GH_HopsFunctions\STATIK_SimplySupportedBeamWithUniformLoad.gh",
    RemoteSolveVersion=(0, 1, 0),
    ShowInput_Enabled=True,
    ShowInput_Path=True,
    SynchronousSolve=True)  # -> Bjælke, Mmax, MX, Mkurve, Vkurve, ReaktionGrafik, LodretReaktion, Vmax
bjælke = ClusterOutput(hops.Bjælke)
mmax = ClusterOutput(hops.Mmax)
m_x = ClusterOutput(hops.MX)
mkurve = ClusterOutput(hops.Mkurve)
vkurve = ClusterOutput(hops.Vkurve)
reaktion_grafik = ClusterOutput(hops.ReaktionGrafik)
lodret_reaktion = ClusterOutput(hops.LodretReaktion)
vmax = ClusterOutput(hops.Vmax)

# ==== cluster HyperbolicTowerWithColumn: Creates a hyperbolic shaped tower out of columns, generates a top beam, and the graphics whit column thickness
hops_shared_folder_path_after_username = Panel("\OC Engineering ApS\Ressourcer - Software and coding\Grasshopper og Rhino\GH_HopsFunctions\")
get_username_of_current_user = GhPythonScript()  # -> username; same code as get_username_of_current_user
hops_shared_folder_path_before_username = Panel("C:\Users\")
username = Panel(get_username_of_current_user)
concatenate = Concatenate(Fragment_A=hops_shared_folder_path_before_username, Fragment_B=username, A=hops_shared_folder_path_after_username)
directory_contents = DirectoryContents(FolderPath=concatenate, Filter="*.gh", IncludeSubfolders=False)  # -> FilePaths, FileNames
item_selector = ItemSelector(
    directory_contents.FileNames,
    {"HopsMasterSheet", "SHAPE_HyperbolicTowerWithColumns", "STATIK_SimplySupportedBeamWithUniformLoad"}, selected="SHAPE_HyperbolicTowerWithColumns")
concatenate_2 = Concatenate(Fragment_A=concatenate, Fragment_B=item_selector, A=".gh")
foundations_amount = ClusterInput()
rotation_sections_amount = ClusterInput()
topbeam_radius_m = ClusterInput()
columns_radius_m = ClusterInput()
radius_bottom_m = ClusterInput()
radius_top_m = ClusterInput()
height_m = ClusterInput()

# ---- group: Edit hops definition
launch_application = LaunchApplication(LaunchToggle=Button(), ApplicationPath=concatenate_2)

# ----
hops = Hops(
    _Path=concatenate_2,
    HeightM=height_m,
    RadiusTopM=radius_top_m,
    RadiusBottomM=radius_bottom_m,
    FoundationsAmount=foundations_amount,
    RotationSectionsAmount=rotation_sections_amount,
    TopBeamRadiusM=topbeam_radius_m,
    ColumnsRadiusM=columns_radius_m,
    CacheResultsInMemory=True,
    CacheSolveResults=True,
    RemoteDefinitionLocation="C:\Users\DBO\OC Engineering ApS\Ressourcer - Software and coding\Grasshopper og Rhino\GH_HopsFunctions\SHAPE_HyperbolicTowerWithColumns.gh",
    RemoteSolveVersion=(0, 1, 0),
    ShowInput_Enabled=False,
    ShowInput_Path=True,
    SynchronousSolve=True)  # -> CenterlineTopBeam, CenterLinesColumns, TopBeam, Columns
centerline_top_beam = ClusterOutput(hops.CenterlineTopBeam)
centerlines_columns = ClusterOutput(hops.CenterLinesColumns)
top_beam = ClusterOutput(hops.TopBeam)
columns = ClusterOutput(hops.Columns)
