# Grasshopper definition SHAPE_HyperbolicTowerWithColumns.gh (Grasshopper 1.0.7)

# Beskrivelse: OC Engineering Grasshopper Template.
# Grafisk standard ses herunder.
# Højre klik på farve og sæt den til standard, grupper herefter og sæt kommentarer på gruppen.
# 
# 
# BESKRIVELSE AF SCRIPT:
# Script der bruges i hops, oploades til GitHub så der er mulighed for at dele hops med flere brugere, da der bruges et link af http.... typen, hvormed den ikke er bruger bestemt i form af en specifik sti.
# 
# TEORI:
# Two column set are created, they are rotated in opposite direction og eachother which created the hyperbolic shape.
# 
# INPUT:
# No comments
# 
# OUTPUT:
# No comments
gældende_udgivelsesdato_og_version = Panel("15.03.2023 - 01.00.00.01")
udviklet_af = Panel("Daniel Bo Olesen")
projekt = Panel("DBO - Diplomingeniør projekt")
# data
# geometry
# preview
# OBS
# big group
# Revisions historik: 01.01.2020 - 01.00.00.00 - første udgivelse - ifm. diplomingeniør projekt
# 15.03.2023 - 01.00.00.01 - Hop'ed up, og lagt på github. til deling
tilføjelser_ændringer_der_kan_implemente = Panel("- ")  # "Tilføjelser ændringer der kan implementeres"
image_sampler = ImageSampler(Filter="Colour", Interpolate=True, Umax=842, Umin=1, Vmax=595, Vmin=1, Wrap=1)

# ---- group: Inputs for testing
rand_bjælke_radius = Slider(0.19149, range=0..1)
# Output
# Input
hoved_søjler_radius = Slider(0.19149, range=0..1)
antal_fundamenter = Slider(17, range=0..100)
radius_bund = Slider(16, range=1..45)
rotation_antal = Slider(6, range=0..30)
højde = Slider(39, range=0..75)
radius_top = Slider(17, range=1..45)

# ---- group: Hops inputs
foundations_amount = GetInteger(antal_fundamenter, AtLeast=1, AtMost=1, Maximum=2147483647, Minimum=-2147483648, TreeAccess=False)
rotation_sections_amount = GetInteger(rotation_antal, AtLeast=1, AtMost=1, Maximum=2147483647, Minimum=-2147483648, TreeAccess=False)
radius_bottom_m = GetNumber(radius_bund, AtLeast=1, AtMost=1, Maximum=1.797693135e+308, Minimum=-1.797693135e+308, TreeAccess=False)
radius_top_m = GetNumber(radius_top, AtLeast=1, AtMost=1, Maximum=1.797693135e+308, Minimum=-1.797693135e+308, TreeAccess=False)
height_m = GetNumber(
    højde,
    AtLeast=1,
    AtMost=1,
    Maximum=1.797693135e+308,
    Minimum=-1.797693135e+308,
    Prompt="Set the height of the tower in meters",
    TreeAccess=False)
topbeam_radius_m = GetNumber(rand_bjælke_radius, AtLeast=1, AtMost=1, Maximum=1.797693135e+308, Minimum=-1.797693135e+308, TreeAccess=False)
columns_radius_m = GetNumber(hoved_søjler_radius, AtLeast=1, AtMost=1, Maximum=1.797693135e+308, Minimum=-1.797693135e+308, TreeAccess=False)

# ---- group: Makes hyperbolic shape from columns + a top beam
construct_point = ConstructPoint(XCoordinate=0, YCoordinate=0, ZCoordinate=height_m)
construct_point_2 = ConstructPoint(XCoordinate=0, YCoordinate=0, ZCoordinate=0)
circle = Circle(Plane=[construct_point, construct_point_2], Radius=[radius_top_m, radius_bottom_m])
divide_curve = DivideCurve(Curve=circle, Count=foundations_amount, Kinks=False)  # -> Points, Tangents, Parameters
explode_tree = ExplodeTree(Data=divide_curve.Points)  # -> Branch0, Branch1
shift_list = ShiftList(List=explode_tree.Branch1, Shift=expr("x*-1", rotation_sections_amount), Wrap=True)
shift_list_2 = ShiftList(List=explode_tree.Branch1, Shift=rotation_sections_amount, Wrap=True)
line = Line(StartPoint=explode_tree.Branch0, EndPoint=shift_list)
line_2 = Line(StartPoint=explode_tree.Branch0, EndPoint=shift_list_2)
circle_2 = Circle(Plane=construct_point, Radius=radius_top_m)
entwine = Entwine(Branch00=line, Branch01=line_2, FlattenInputs=True)
pipe = Pipe(Curve=circle_2, Radius=topbeam_radius_m, Caps=0)
pipe_2 = Pipe(Curve=[line_2, line, circle_2], Radius=columns_radius_m, Caps=0)

# ---- group: Hops outputs / GH_OUT:B
context_bake = ContextBake(CenterLinesColumns=entwine)

# ---- group: Hops outputs / GH_OUT:A
context_bake_2 = ContextBake(CenterlineTopBeam=circle_2)

# ---- group: Hops outputs / GH_OUT:D
context_bake_3 = ContextBake(Geometry=pipe_2)

# ---- group: Hops outputs / GH_OUT:C
context_bake_4 = ContextBake(Geometry=pipe)
