# Grasshopper definition STATIK simpelt understøttet bjælke med jævnt fordelt linjelast.gh (Grasshopper 1.0.7)

# Output
# Input
# data
# geometry
# preview
# OBS
# big group
revisions_historik = Panel("15.03.2023 - 01.00.00.00 - første udgivelse")
tilføjelser_ændringer_der_kan_implemente = Panel("- Indbyg udbøjning formel")  # "Tilføjelser ændringer der kan implementeres"
udviklet_af = Panel("Daniel Bo Olesen")
# Beskrivelse: OC Engineering Grasshopper Template.
# Grafisk standard ses herunder.
# Højre klik på farve og sæt den til standard, grupper herefter og sæt kommentarer på gruppen.
# 
# 
# BESKRIVELSE AF SCRIPT:
# Script der bruges i hops, oploades til GitHub så der er mulighed for at dele hops med flere brugere, da der bruges et link af http.... typen, hvormed den ikke er bruger bestemt i form af en specifik sti.
# 
# TEORI:
# Der regnes en simpelt understøttet bjælke ud 	fra standard teori i teknisk ståbi.
# 
# INPUT:
# Der gives input som angivet, skala påvirker udelukkende grafisk fremstilling af output. Beregninger punkter er antallet af punkter der regnes i funktionerne M(x) og V(x)
# 
# OUTPUT:
# Der gives M_max (værdi) M(x) funktion der kan 	evalueres og tegnes M_kurve. Der gives reaktioner grafisk og som værdi. Der gives forskydningskræfter som moment, max, funktion og visuel.
# Endviderer gives et ourput med bjælke som en 	curve.
udgivelsesdato_og_version = Panel("15.03.2023 - 01.00.00.00")
projekt = Panel("OCE - Hops Defination")
# [PancakeVersion]
# create_new
# 164111699.42387
# DESKTOP-N2HVDCC
# modified
# 164112204.9646
# DESKTOP-N2HVDCC
image_sampler = ImageSampler(Filter="Colour", Interpolate=True, Umax=842, Umin=1, Vmax=595, Vmin=1, Wrap=1)

# ---- group: Input for testing purpose
antal_beregningspunkter = Slider(128, range=0..200)
skala = Slider(0.002, range=0..0.01)
længde_i_m = Slider(11.52, range=0..15)
last_i_kn_m = Slider(50, range=0..100)

# ---- group: Hops input
længde = GetNumber(længde_i_m, AtLeast=1, AtMost=1, Maximum=1.797693135e+308, Minimum=-1.797693135e+308, TreeAccess=False)
skaler_kurve = GetNumber(skala, AtLeast=1, AtMost=1, Maximum=1.797693135e+308, Minimum=-1.797693135e+308, TreeAccess=False)
last = GetNumber(last_i_kn_m, AtLeast=1, AtMost=1, Maximum=1.797693135e+308, Minimum=-1.797693135e+308, TreeAccess=False)
antal_opdelinger = GetNumber(antal_beregningspunkter, AtLeast=1, AtMost=1, Maximum=1.797693135e+308, Minimum=-1.797693135e+308, TreeAccess=False)

# ---- group: Samlet funktion / Bjælke geometri
construct_point = ConstructPoint(XCoordinate=0, YCoordinate=0, ZCoordinate=0)
construct_point_2 = ConstructPoint(XCoordinate=0, YCoordinate=længde, ZCoordinate=0)
line = Line(StartPoint=construct_point, EndPoint=construct_point_2)

# ---- group: Samlet funktion / Beregning V
evaluate = Evaluate(Expression="1/2*q*l", q=last, l=længde)

# ---- group: Samlet funktion / grafik moment
divide_curve = DivideCurve(Curve=line, Count=antal_opdelinger, Kinks=False)  # -> Points, Tangents, Parameters
deconstruct = Deconstruct(Point=divide_curve.Points)  # -> XComponent, YComponent, ZComponent

# ---- group: Samlet funktion / V grafik
multiplication = Multiplication(A=evaluate, B=skaler_kurve)
construct_point_3 = ConstructPoint(XCoordinate=0, YCoordinate=længde, ZCoordinate=expr("x*-1", multiplication))
construct_point_4 = ConstructPoint(XCoordinate=0, YCoordinate=0, ZCoordinate=multiplication)
line_2 = Line(StartPoint=construct_point_4, EndPoint=construct_point_3)
divide_curve_2 = DivideCurve(Curve=line_2, Count=antal_opdelinger, Kinks=False)  # -> Points, Tangents, Parameters
line_3 = Line(StartPoint=divide_curve.Points, EndPoint=divide_curve_2.Points)

# ---- group: Samlet funktion / Beregning moment
evaluate_2 = Evaluate(Expression="1/8*q*l^2", q=last, l=længde)
evaluate_3 = Evaluate(Expression="1/2*q*x*(l-x)", q=last, x=deconstruct.YComponent, l=længde)

# ---- group: Samlet funktion / Grafik reaktion
line_4 = Line(StartPoint=construct_point, EndPoint=expr("x*-1", construct_point_4))
line_5 = Line(StartPoint=construct_point_2, EndPoint=construct_point_3)

# ---- group: Samlet funktion / grafik moment (continued)
multiplication_2 = Multiplication(A=evaluate_3, B=skaler_kurve, C=-1)
construct_point_5 = ConstructPoint(XCoordinate=deconstruct.XComponent, YCoordinate=deconstruct.YComponent, ZCoordinate=multiplication_2)
interpolate = Interpolate(Vertices=construct_point_5, Degree=3, Periodic=False, KnotStyle=1)  # -> Curve, Length, Domain
line_6 = Line(StartPoint=divide_curve.Points, EndPoint=construct_point_5)

# ---- group: Hops output
context_bake = ContextBake(Geometry=[interpolate.Curve, line_6])
context_print = ContextPrint(Text=evaluate_2)
context_bake_2 = ContextBake(Geometry=[line_3, line_2])
context_print_2 = ContextPrint(Text=evaluate_3)
context_print_3 = ContextPrint(LodretReaktion=evaluate)
context_bake_3 = ContextBake(ReaktionGrafik=[line_4, line_5])
context_bake_4 = ContextBake(Geometry=line)
context_print_4 = ContextPrint(Text=evaluate)
